# Dynamo graph Shrubs Scatter Tool v 1.50 .dyn "Shrubs Scatter Tool v 1.50" (Dynamo 2.16.1.2727)

# group: #Shrubs Scatter Tool V 1.40
# note: Ⓒ Copyright of Script to Paragons Egypt Team

# group: #Offsets
# note: # Just in case if needed to adjust the offsets of  the Shrubs

# group: 1-Select Shrubs Area
# note: # Note : load shrubs Family From Family Mangment
#              Before run the Script
# note: # First : Pick Shrubs Area
n1_select_shrub_floor_face = DSFaceSelection()  # "1-Select Shrub Floor Face"; 1 picked in the model; graph input

# group: Scipt Process > Script Control
perimeterCurves = Surface.PerimeterCurves(surface=n1_select_shrub_floor_face, lacing=Shortest)
byJoinedCurves = PolyCurve.ByJoinedCurves(curves=perimeterCurves)

outter_offset = DoubleInput(-1)

# group: 3- Adjust The Path
# note: # Just in case if needed to Adjust Spacing Between the Shrubs
j_i_c_the_distance_between = DoubleInput(2.2)  # "J.I.C-*The Distance between Shrubs at the Path (Check Order)"; graph input

# group: Scipt Process > Shrubs
bush = FamilyTypes("WTS_Shrubs_Detailed:Bush")
flowers = FamilyTypes("WTS_Shrubs_Detailed:Flowers")
small_bush = FamilyTypes("WTS_Shrubs_Detailed:Small Bush")
list_create = List.Create(item0=bush, item1=flowers, item2=small_bush, item3=flowers)
number = DoubleInput(200)
ofRepeatedItem = List.OfRepeatedItem(item=list_create, amount=number)
flatten = List.Flatten(list=ofRepeatedItem)

# group: Scipt Process > Path of Shrups
offsetMany = Curve.OffsetMany(curve=byJoinedCurves, signedDistance=outter_offset)
length = Curve.Length(curve=offsetMany)
code_block = CodeBlock(length=length, space=j_i_c_the_distance_between) { length/space; }
code_block_2 = CodeBlock(length=length, space=j_i_c_the_distance_between) { length/space; }
code_block_3 = CodeBlock(n=code_block_2, space=j_i_c_the_distance_between) { 0..#n..space; }
pointAtSegmentLength = Curve.PointAtSegmentLength(curve=offsetMany, segmentLength=code_block_3)
flatten_2 = List.Flatten(list=pointAtSegmentLength)
byPoint = FamilyInstance.ByPoint(familyType=flatten, point=flatten_2)

outter_offset_2 = DoubleInput(-2.4)

# group: Scipt Process > Path of Shrups
offsetMany_2 = Curve.OffsetMany(curve=byJoinedCurves, signedDistance=outter_offset_2)
length_2 = Curve.Length(curve=offsetMany_2)
code_block_4 = CodeBlock(length=length_2, space=j_i_c_the_distance_between) { length/space; }
code_block_5 = CodeBlock(n=code_block_4, space=j_i_c_the_distance_between) { 0..#n..space; }
pointAtSegmentLength_2 = Curve.PointAtSegmentLength(curve=offsetMany_2, segmentLength=code_block_5)
flatten_3 = List.Flatten(list=pointAtSegmentLength_2)
byPoint_2 = FamilyInstance.ByPoint(familyType=flatten, point=flatten_3)
code_block_6 = CodeBlock(length=length_2, space=j_i_c_the_distance_between) { length/space; }

outter_offset_3 = DoubleInput(-3.8)

# group: Path of Shrups
offsetMany_3 = Curve.OffsetMany(curve=byJoinedCurves, signedDistance=outter_offset_3)
length_3 = Curve.Length(curve=offsetMany_3)
code_block_7 = CodeBlock(length=length_3, space=j_i_c_the_distance_between) { length/space; }
code_block_8 = CodeBlock(n=code_block_7, space=j_i_c_the_distance_between) { 0..#n..space; }
pointAtSegmentLength_3 = Curve.PointAtSegmentLength(curve=offsetMany_3, segmentLength=code_block_8)
flatten_4 = List.Flatten(list=pointAtSegmentLength_3)
byPoint_3 = FamilyInstance.ByPoint(familyType=flatten, point=flatten_4)
code_block_9 = CodeBlock(length=length_3, space=j_i_c_the_distance_between) { length/space; }

outter_offset_4 = DoubleInput(-5.2)

# group: Path of Shrups
offsetMany_4 = Curve.OffsetMany(curve=byJoinedCurves, signedDistance=outter_offset_4)
length_4 = Curve.Length(curve=offsetMany_4)
code_block_10 = CodeBlock(length=length_4, space=j_i_c_the_distance_between) { length/space; }
code_block_11 = CodeBlock(n=code_block_10, space=j_i_c_the_distance_between) { 0..#n..space; }
pointAtSegmentLength_4 = Curve.PointAtSegmentLength(curve=offsetMany_4, segmentLength=code_block_11)
flatten_5 = List.Flatten(list=pointAtSegmentLength_4)
byPoint_4 = FamilyInstance.ByPoint(familyType=flatten, point=flatten_5)
code_block_12 = CodeBlock(length=length_4, space=j_i_c_the_distance_between) { length/space; }
