# Dynamo graph Shrubs Scatter Tool v 1.51 .dyn "Shrubs Scatter Tool v 1.51" (Dynamo 2.16.1.2727)

# group: #Shrubs Scatter Tool V 1.40
# note: Ⓒ Copyright of Script to Paragons Egypt Team

# group: #Offsets
# note: # Just in case if needed to adjust the offsets of  the Shrubs

# group: 1-Select Shrubs Area
# note: # Note : load shrubs Family From Family Mangment
#              Before run the Script
# note: # First : Pick Shrubs Area
n1_select_shrub_floor_face = DSFaceSelection()  # "1-Select Shrub Floor Face"; 1 picked in the model; graph input

# group: Scipt Process > Script Control
perimeterCurves = Surface.PerimeterCurves(surface=n1_select_shrub_floor_face, lacing=Shortest)
byJoinedCurves = PolyCurve.ByJoinedCurves(curves=perimeterCurves)

# group: Scipt Process > 3- Adjust The spacing Between Shrubs
# note: # Just in case if needed to Adjust Spacing Between the Shrubs
j_i_c_the_distance_between = DoubleInput(2.9)  # "J.I.C-*The Distance between Shrubs at the Path (Check Order)"; graph input

# group: Scipt Process > Shrubs
bush = FamilyTypes("WTS_Shrubs_Detailed:Bush")
flowers = FamilyTypes("WTS_Shrubs_Detailed:Flowers")
small_bush = FamilyTypes("WTS_Shrubs_Detailed:Small Bush")
list_create = List.Create(item0=bush, item1=flowers, item2=small_bush, item3=flowers)
number = DoubleInput(200)
ofRepeatedItem = List.OfRepeatedItem(item=list_create, amount=number)
flatten = List.Flatten(list=ofRepeatedItem)

# group: Path of Shrups
outter_offset = DoubleInput(-1)
offsetMany = Curve.OffsetMany(curve=byJoinedCurves, signedDistance=outter_offset)
length = Curve.Length(curve=offsetMany)
code_block = CodeBlock(length=length, space=j_i_c_the_distance_between) { length/space; }
code_block_2 = CodeBlock(length=length, space=j_i_c_the_distance_between) { length/space; }
code_block_3 = CodeBlock(n=code_block_2, space=j_i_c_the_distance_between) { 0..#n..space; }
pointAtSegmentLength = Curve.PointAtSegmentLength(curve=offsetMany, segmentLength=code_block_3)
flatten_2 = List.Flatten(list=pointAtSegmentLength)
byPoint = FamilyInstance.ByPoint(familyType=flatten, point=flatten_2)

number_2 = DoubleInput(-2.4)
number_slider = DoubleSlider(27.9, range=0..100 step 0.1)

# group: Scipt Process > Path of Shrups
offsetMany_2 = Curve.OffsetMany(curve=byJoinedCurves, signedDistance=number_2)
length_2 = Curve.Length(curve=offsetMany_2)
code_block_4 = CodeBlock(length=length_2, space=j_i_c_the_distance_between) { length/space; }
code_block_5 = CodeBlock(length=length_2, space=j_i_c_the_distance_between) { length/space; }
code_block_6 = CodeBlock(n=code_block_5, space=j_i_c_the_distance_between) { 0..#n..space; }
pointAtSegmentLength_2 = Curve.PointAtSegmentLength(curve=offsetMany_2, segmentLength=code_block_6)
flatten_3 = List.Flatten(list=pointAtSegmentLength_2, amount=number_slider)

list_create_2 = List.Create(item0=flatten_3)
number_slider_2 = DoubleSlider(61.6, range=0..100 step 0.1)
shuffle = List.Shuffle(list=list_create_2, seed=number_slider_2)
flatten_4 = List.Flatten(list=shuffle)
byPoint_2 = FamilyInstance.ByPoint(familyType=flatten, point=flatten_4)
number_slider_3 = DoubleSlider(5.8, range=0..100 step 0.1)
code_block_7 = CodeBlock { -2.4..-10.8..#8; }
