# Dynamo graph Shrubs Scatter Tool v 1.52 .dyn "Shrubs Scatter Tool v 1.52" (Dynamo 2.16.1.2727)

# group: #Shrubs Scatter Tool V 1.40
# note: Ⓒ Copyright of Script to Paragons Egypt Team

# group: #Offsets
# note: # Just in case if needed to adjust the offsets of  the Shrubs

# group: Scipt Process > 3- Adjust The spacing Between Shrubs
# note: # Just in case if needed to Adjust Spacing Between the Shrubs
j_i_c_the_distance_between = DoubleInput(2.5)  # "J.I.C-*The Distance between Shrubs at the Path (Check Order)"; graph input

# group: 1-Select Shrubs Area
# note: # Note : load shrubs Family From Family Mangment
#              Before run the Script
# note: # First : Pick Shrubs Area
n1_select_shrub_floor_face = DSFaceSelection()  # "1-Select Shrub Floor Face"; 1 picked in the model; graph input

# group: Scipt Process > Script Control
perimeterCurves = Surface.PerimeterCurves(surface=n1_select_shrub_floor_face, lacing=Shortest)
byJoinedCurves = PolyCurve.ByJoinedCurves(curves=perimeterCurves)

number = DoubleInput(-2.4)
code_block = CodeBlock { 2.2..10..#10; }

# group: Scipt Process > Path of Shrups
offsetMany = Curve.OffsetMany(curve=byJoinedCurves, signedDistance=number)
length = Curve.Length(curve=offsetMany)
code_block_2 = CodeBlock(length=length, space=code_block) { length/space; }
code_block_3 = CodeBlock(length=length, space=code_block) { length/space; }
code_block_4 = CodeBlock(n=code_block_3, space=code_block) { 0..#n..space; }
pointAtSegmentLength = Curve.PointAtSegmentLength(curve=offsetMany, segmentLength=code_block_4)

# group: Scipt Process > Shrubs
bush = FamilyTypes("WTS_Shrubs_Detailed:Bush")
flowers = FamilyTypes("WTS_Shrubs_Detailed:Flowers")
small_bush = FamilyTypes("WTS_Shrubs_Detailed:Small Bush")
list_create = List.Create(item0=bush, item1=flowers, item2=small_bush, item3=flowers)
number_2 = DoubleInput(200)
ofRepeatedItem = List.OfRepeatedItem(item=list_create, amount=number_2)
flatten = List.Flatten(list=ofRepeatedItem)

number_slider = DoubleSlider(42, range=0..100 step 0.1)
shuffle = List.Shuffle(list=pointAtSegmentLength, seed=number_slider)
flatten_2 = List.Flatten(list=shuffle)
byPoint = FamilyInstance.ByPoint(familyType=flatten, point=flatten_2)
number_slider_2 = DoubleSlider(5.8, range=0..100 step 0.1)
code_block_5 = CodeBlock { -2.4..-10.8..#8; }
