# Dynamo graph Shrubs Scatter Tool v 1.53 .dyn "Shrubs Scatter Tool v 1.53" (Dynamo 2.16.2.5624)

# group: #Shrubs Scatter Tool V 1.40
# note: Ⓒ Copyright of Script to Paragons Egypt Team

# group: Scipt Process > Shrubs
bush = FamilyTypes("WTS_Shrubs_Detailed:Bush")
flowers = FamilyTypes("WTS_Shrubs_Detailed:Flowers")
small_bush = FamilyTypes("WTS_Shrubs_Detailed:Small Bush")
list_create = List.Create(item0=bush, item1=flowers, item2=small_bush, item3=flowers)
number = DoubleInput(200)
ofRepeatedItem = List.OfRepeatedItem(item=list_create, amount=number)
flatten = List.Flatten(list=ofRepeatedItem)
list_create_2 = List.Create(item0=bush, item1=flowers, item2=small_bush)
ofRepeatedItem_2 = List.OfRepeatedItem(item=list_create_2, amount=number)
shuffle = List.Shuffle(list=ofRepeatedItem_2)  # unwired: seed

# group: Select Shrubs Area
# note: # Note : load shrubs Family From Family Mangment
#              Before run the Script
# note: # First : Pick Shrubs Area
select_shrub_floor_face = DSFaceSelection()  # 1 picked in the model; graph input

# group: Scipt Process > Script Control
perimeterCurves = Surface.PerimeterCurves(surface=select_shrub_floor_face, lacing=Shortest)
byJoinedCurves = PolyCurve.ByJoinedCurves(curves=perimeterCurves)

outter_offset = DoubleInput(-2.65)

# group: Scipt Process > 3- Adjust The spacing Between Shrubs
# note: # Just in case if needed to Adjust Spacing Between the Shrubs
j_i_c_the_distance_between = DoubleInput(2.3)  # "J.I.C-*The Distance between Shrubs at the Path (Check Order)"

# group: Inner Part > Path of Shrubs
offsetMany = Curve.OffsetMany(curve=byJoinedCurves, signedDistance=outter_offset)
length = Curve.Length(curve=offsetMany)
code_block = CodeBlock(length=length, space=j_i_c_the_distance_between) { length/space; }
code_block_2 = CodeBlock(n=code_block, space=j_i_c_the_distance_between) { 0..#n..space; }
pointAtSegmentLength = Curve.PointAtSegmentLength(curve=offsetMany, segmentLength=code_block_2)
flatten_2 = List.Flatten(list=pointAtSegmentLength)
code_block_3 = CodeBlock(length=length, space=j_i_c_the_distance_between) { length/space; }

outter_offset_2 = DoubleInput(-5.95)

# group: Inner Part > Path of Shrubs
offsetMany_2 = Curve.OffsetMany(curve=byJoinedCurves, signedDistance=outter_offset_2)
length_2 = Curve.Length(curve=offsetMany_2)
code_block_4 = CodeBlock(length=length_2, space=j_i_c_the_distance_between) { length/space; }
code_block_5 = CodeBlock(n=code_block_4, space=j_i_c_the_distance_between) { 0..#n..space; }
pointAtSegmentLength_2 = Curve.PointAtSegmentLength(curve=offsetMany_2, segmentLength=code_block_5)
flatten_3 = List.Flatten(list=pointAtSegmentLength_2)
code_block_6 = CodeBlock(length=length_2, space=j_i_c_the_distance_between) { length/space; }

outter_offset_3 = DoubleInput(-9.25)

# group: Inner Part > Path of Shrubs
offsetMany_3 = Curve.OffsetMany(curve=byJoinedCurves, signedDistance=outter_offset_3)
length_3 = Curve.Length(curve=offsetMany_3)
code_block_7 = CodeBlock(length=length_3, space=j_i_c_the_distance_between) { length/space; }
code_block_8 = CodeBlock(n=code_block_7, space=j_i_c_the_distance_between) { 0..#n..space; }
pointAtSegmentLength_3 = Curve.PointAtSegmentLength(curve=offsetMany_3, segmentLength=code_block_8)
flatten_4 = List.Flatten(list=pointAtSegmentLength_3)
code_block_9 = CodeBlock(length=length_3, space=j_i_c_the_distance_between) { length/space; }

outter_offset_4 = DoubleInput(-12.55)

# group: Inner Part > Path of Shrubs
offsetMany_4 = Curve.OffsetMany(curve=byJoinedCurves, signedDistance=outter_offset_4)
length_4 = Curve.Length(curve=offsetMany_4)
code_block_10 = CodeBlock(length=length_4, space=j_i_c_the_distance_between) { length/space; }
code_block_11 = CodeBlock(n=code_block_10, space=j_i_c_the_distance_between) { 0..#n..space; }
pointAtSegmentLength_4 = Curve.PointAtSegmentLength(curve=offsetMany_4, segmentLength=code_block_11)
flatten_5 = List.Flatten(list=pointAtSegmentLength_4)
code_block_12 = CodeBlock(length=length_4, space=j_i_c_the_distance_between) { length/space; }

outter_offset_5 = DoubleInput(-4.3)

# group: Inner Part > Path of Shrubs
offsetMany_5 = Curve.OffsetMany(curve=byJoinedCurves, signedDistance=outter_offset_5)
length_5 = Curve.Length(curve=offsetMany_5)
code_block_13 = CodeBlock(length=length_5, space=j_i_c_the_distance_between) { length/space; }
code_block_14 = CodeBlock(n=code_block_13, space=j_i_c_the_distance_between) { 0..#n..space; }
pointAtSegmentLength_5 = Curve.PointAtSegmentLength(curve=offsetMany_5, segmentLength=code_block_14)
flatten_6 = List.Flatten(list=pointAtSegmentLength_5)
code_block_15 = CodeBlock(length=length_5, space=j_i_c_the_distance_between) { length/space; }

outter_offset_6 = DoubleInput(-7.6)

# group: Inner Part > Path of Shrubs
offsetMany_6 = Curve.OffsetMany(curve=byJoinedCurves, signedDistance=outter_offset_6)
length_6 = Curve.Length(curve=offsetMany_6)
code_block_16 = CodeBlock(length=length_6, space=j_i_c_the_distance_between) { length/space; }
code_block_17 = CodeBlock(n=code_block_16, space=j_i_c_the_distance_between) { 0..#n..space; }
pointAtSegmentLength_6 = Curve.PointAtSegmentLength(curve=offsetMany_6, segmentLength=code_block_17)
flatten_7 = List.Flatten(list=pointAtSegmentLength_6)
code_block_18 = CodeBlock(length=length_6, space=j_i_c_the_distance_between) { length/space; }

outter_offset_7 = DoubleInput(-10.9)

# group: Inner Part > Path of Shrubs
offsetMany_7 = Curve.OffsetMany(curve=byJoinedCurves, signedDistance=outter_offset_7)
length_7 = Curve.Length(curve=offsetMany_7)
code_block_19 = CodeBlock(length=length_7, space=j_i_c_the_distance_between) { length/space; }
code_block_20 = CodeBlock(n=code_block_19, space=j_i_c_the_distance_between) { 0..#n..space; }
pointAtSegmentLength_7 = Curve.PointAtSegmentLength(curve=offsetMany_7, segmentLength=code_block_20)
flatten_8 = List.Flatten(list=pointAtSegmentLength_7)
code_block_21 = CodeBlock(length=length_7, space=j_i_c_the_distance_between) { length/space; }

outter_offset_8 = DoubleInput(-14.2)

# group: Inner Part > Path of Shrubs
offsetMany_8 = Curve.OffsetMany(curve=byJoinedCurves, signedDistance=outter_offset_8)
length_8 = Curve.Length(curve=offsetMany_8)
code_block_22 = CodeBlock(length=length_8, space=j_i_c_the_distance_between) { length/space; }
code_block_23 = CodeBlock(n=code_block_22, space=j_i_c_the_distance_between) { 0..#n..space; }
pointAtSegmentLength_8 = Curve.PointAtSegmentLength(curve=offsetMany_8, segmentLength=code_block_23)
flatten_9 = List.Flatten(list=pointAtSegmentLength_8)
code_block_24 = CodeBlock(length=length_8, space=j_i_c_the_distance_between) { length/space; }

# group: Output
list_create_3 = List.Create(item0=flatten_2, item1=flatten_3, item2=flatten_4, item3=flatten_5)
reverse = List.Reverse(list=list_create_3)
list_create_4 = List.Create(item0=flatten_6, item1=flatten_7, item2=flatten_8, item3=flatten_9)
list_create_5 = List.Create(item0=reverse, item1=list_create_4)
flatten_10 = List.Flatten(list=list_create_5)
byPoint = FamilyInstance.ByPoint(familyType=flatten, point=flatten_10)

# group: Outer Path of Shrubs
outter_offset_9 = DoubleInput(-1)
offsetMany_9 = Curve.OffsetMany(curve=byJoinedCurves, signedDistance=outter_offset_9)
length_9 = Curve.Length(curve=offsetMany_9)
code_block_25 = CodeBlock(length=length_9, space=j_i_c_the_distance_between) { length/space; }
code_block_26 = CodeBlock(n=code_block_25, space=j_i_c_the_distance_between) { 0..#n..space; }
pointAtSegmentLength_9 = Curve.PointAtSegmentLength(curve=offsetMany_9, segmentLength=code_block_26)
flatten_11 = List.Flatten(list=pointAtSegmentLength_9)
byPoint_2 = FamilyInstance.ByPoint(familyType=flatten, point=flatten_11)

outter_offset_10 = DoubleInput(-15.85)

# group: Inner Part > Path of Shrubs
offsetMany_10 = Curve.OffsetMany(curve=byJoinedCurves, signedDistance=outter_offset_10)
length_10 = Curve.Length(curve=offsetMany_10)
code_block_27 = CodeBlock(length=length_10, space=j_i_c_the_distance_between) { length/space; }
code_block_28 = CodeBlock(n=code_block_27, space=j_i_c_the_distance_between) { 0..#n..space; }
pointAtSegmentLength_10 = Curve.PointAtSegmentLength(curve=offsetMany_10, segmentLength=code_block_28)
flatten_12 = List.Flatten(list=pointAtSegmentLength_10)
code_block_29 = CodeBlock(length=length_10, space=j_i_c_the_distance_between) { length/space; }

outter_offset_11 = DoubleInput(-17)

# group: Inner Part > Path of Shrubs
offsetMany_11 = Curve.OffsetMany(curve=byJoinedCurves, signedDistance=outter_offset_11)
length_11 = Curve.Length(curve=offsetMany_11)
code_block_30 = CodeBlock(length=length_11, space=j_i_c_the_distance_between) { length/space; }
code_block_31 = CodeBlock(n=code_block_30, space=j_i_c_the_distance_between) { 0..#n..space; }
pointAtSegmentLength_11 = Curve.PointAtSegmentLength(curve=offsetMany_11, segmentLength=code_block_31)
flatten_13 = List.Flatten(list=pointAtSegmentLength_11)
code_block_32 = CodeBlock(length=length_11, space=j_i_c_the_distance_between) { length/space; }
