# Dynamo graph Shrubs Scatter Tool v 1.54  old.dyn "Shrubs Scatter Tool v 1.54" (Dynamo 2.16.2.5624)

# group: #Shrubs Scatter Tool V 1.40
# note: Ⓒ Copyright of Script to Paragons Egypt Team

# group: Scipt Process > Shrubs
bush = FamilyTypes("WTS_Shrubs_Detailed:Bush")
flowers = FamilyTypes("WTS_Shrubs_Detailed:Flowers")
small_bush = FamilyTypes("WTS_Shrubs_Detailed:Small Bush")
list_create = List.Create(item0=bush, item1=flowers, item2=small_bush, item3=flowers)
number = DoubleInput(200)
ofRepeatedItem = List.OfRepeatedItem(item=list_create, amount=number)
flatten = List.Flatten(list=ofRepeatedItem)

# group: Select Shrubs Area
# note: # Note : load shrubs Family From Family Mangment
#              Before run the Script
# note: # First : Pick Shrubs Area
select_shrub_floor_face = DSFaceSelection()  # 1 picked in the model; graph input

# group: Scipt Process > Script Control
perimeterCurves = Surface.PerimeterCurves(surface=select_shrub_floor_face, lacing=Shortest)
byJoinedCurves = PolyCurve.ByJoinedCurves(curves=perimeterCurves)

# group: Scipt Process > 3- Adjust The spacing Between Shrubs
# note: # Just in case if needed to Adjust Spacing Between the Shrubs
j_i_c_the_distance_between = DoubleInput(2.3)  # "J.I.C-*The Distance between Shrubs at the Path (Check Order)"

# group: Inner Path of Shrubs
outter_offset = DoubleInput(-2.4)
outter_offset_2 = DoubleInput(-12.2)
number_slider = DoubleSlider(0, range=0..5 step 1)
sub = outter_offset_2 - number_slider
outter_offset_3 = DoubleInput(8)
code_block = CodeBlock(a=outter_offset, b=sub, n=outter_offset_3) { a..b..#n; }
offsetMany = Curve.OffsetMany(curve=byJoinedCurves, signedDistance=code_block, lacing=CrossProduct)
length = Curve.Length(curve=offsetMany)
code_block_2 = CodeBlock(length=length, space=j_i_c_the_distance_between) { length/space; }
code_block_3 = CodeBlock(n=code_block_2, space=j_i_c_the_distance_between) { 0..#n..space; }
pointAtSegmentLength = Curve.PointAtSegmentLength(curve=offsetMany, segmentLength=code_block_3)
flatten_2 = List.Flatten(list=pointAtSegmentLength)
code_block_4 = CodeBlock(length=length, space=j_i_c_the_distance_between) { length/space; }

# group: Output
reverse = List.Reverse(list=flatten_2)
flatten_3 = List.Flatten(list=reverse)
byPoint = FamilyInstance.ByPoint(familyType=flatten, point=flatten_3)

# group: Outer Path of Shrubs
outter_offset_4 = DoubleInput(-1)
offsetMany_2 = Curve.OffsetMany(curve=byJoinedCurves, signedDistance=outter_offset_4)
length_2 = Curve.Length(curve=offsetMany_2)
code_block_5 = CodeBlock(length=length_2, space=j_i_c_the_distance_between) { length/space; }
code_block_6 = CodeBlock(n=code_block_5, space=j_i_c_the_distance_between) { 0..#n..space; }
pointAtSegmentLength_2 = Curve.PointAtSegmentLength(curve=offsetMany_2, segmentLength=code_block_6)
flatten_4 = List.Flatten(list=pointAtSegmentLength_2)
byPoint_2 = FamilyInstance.ByPoint(familyType=flatten, point=flatten_4)
