# Dynamo graph Shrubs Scatter Tool v 1.57 .dyn "Shrubs Scatter Tool v 1.57" (Dynamo 2.16.2.5624)
# author: Yousef Altear
# Scattering the Shrubs by Selected The Face of the Shrubs Floor inside The Revit
# packages: bimorphNodes 5.1.3

# group: #Shrubs Scatter Tool V 1.57
# note: Ⓒ Copyright of Script to Paragons Egypt Team

# group: Scipt Process > Shrubs
bush = FamilyTypes("WTS_Shrubs_Detailed:Bush")
flowers = FamilyTypes("WTS_Shrubs_Detailed:Flowers")
small_bush = FamilyTypes("WTS_Shrubs_Detailed:Small Bush")
list_create = List.Create(item0=bush, item1=flowers, item2=small_bush, item3=flowers)
number = DoubleInput(400)
ofRepeatedItem = List.OfRepeatedItem(item=list_create, amount=number)
flatten = List.Flatten(list=ofRepeatedItem)
list_create_2 = List.Create(item0=bush, item1=flowers, item2=small_bush)
ofRepeatedItem_2 = List.OfRepeatedItem(item=list_create_2, amount=number)
randomization = DoubleSlider(26, range=1..100 step 1)  # graph input
flatten_2 = List.Flatten(list=ofRepeatedItem_2, amount=randomization)
shuffle = List.Shuffle(list=flatten_2, seed=randomization)

# group: Select Shrubs Area
# note: # Note : load shrubs Family From Family Mangment
#              Before run the Script
# note: # First : Pick Shrubs Area
select_shrub_floor_face_make = DSFaceSelection()  # "-Select Shrub Floor Face " make sure to add Shrubs Family Before run the script ""; 1 picked in the model; graph input

# group: Scipt Process > Script Control
perimeterCurves = Surface.PerimeterCurves(surface=select_shrub_floor_face_make, lacing=Shortest)
byJoinedCurves = PolyCurve.ByJoinedCurves(curves=perimeterCurves)

# group: Scipt Process > 3- Adjust The spacing Between Shrubs
# note: # Just in case if needed to Adjust Spacing Between the Shrubs
j_i_c_the_distance_between = DoubleInput(2.3)  # "J.I.C-*The Distance between Shrubs at the Path (Check Order)"

# group: Outer Path of Shrubs
outter_offset = DoubleInput(-1)
offsetMany = Curve.OffsetMany(curve=byJoinedCurves, signedDistance=outter_offset)
length = Curve.Length(curve=offsetMany)
code_block = CodeBlock(length=length, space=j_i_c_the_distance_between) { length/space; }
code_block_2 = CodeBlock(n=code_block, space=j_i_c_the_distance_between) { 0..#n..space; }
pointAtSegmentLength = Curve.PointAtSegmentLength(curve=offsetMany, segmentLength=code_block_2)
flatten_3 = List.Flatten(list=pointAtSegmentLength)
byPoint = FamilyInstance.ByPoint(familyType=flatten, point=flatten_3)

# group: Outer Path of Shrubs
outter_offset_2 = DoubleInput(-2.6)
offsetMany_2 = Curve.OffsetMany(curve=byJoinedCurves, signedDistance=outter_offset_2)
length_2 = Curve.Length(curve=offsetMany_2)
code_block_3 = CodeBlock(length=length_2, space=j_i_c_the_distance_between) { length/space; }
code_block_4 = CodeBlock(n=code_block_3, space=j_i_c_the_distance_between) { 0..#n..space; }
pointAtSegmentLength_2 = Curve.PointAtSegmentLength(curve=offsetMany_2, segmentLength=code_block_4)
flatten_4 = List.Flatten(list=pointAtSegmentLength_2)
byPoint_2 = FamilyInstance.ByPoint(familyType=flatten, point=flatten_4)

# group: Inner fill
number_2 = DoubleInput(-4.2)
offsetMany_3 = Curve.OffsetMany(curve=byJoinedCurves, signedDistance=number_2)
byPatch = Surface.ByPatch(closedCurve=offsetMany_3, lacing=CrossProduct)
area = Surface.Area(surface=byPatch)
maximumItem = List.MaximumItem(list=area)
eq = area == maximumItem
filterByBoolMask = List.FilterByBoolMask(list=byPatch, mask=eq)
flatten_5 = List.Flatten(list=filterByBoolMask.in)
code_block_5 = CodeBlock { "Point"; }

# group: Inner fill > Automatic Grid
offsetMany_4 = Curve.OffsetMany(curve=byJoinedCurves, signedDistance=number_2)
byPatch_2 = Surface.ByPatch(closedCurve=offsetMany_4)
area_2 = Surface.Area(surface=byPatch_2)
maximumItem_2 = List.MaximumItem(list=area_2)
eq_2 = area_2 == maximumItem_2
filterByBoolMask_2 = List.FilterByBoolMask(list=byPatch_2, mask=eq_2)
flatten_6 = List.Flatten(list=filterByBoolMask_2.in)
u_direction = DoubleSlider(3, range=0..30 step 1)
code_block_6 = CodeBlock(a=u_direction) { 1/a; }
code_block_7 = CodeBlock(a=code_block_6) { 0..1..~a; }
code_block_8 = CodeBlock(a=u_direction) { 1/a; }
code_block_9 = CodeBlock(a=code_block_8) { 0..1..~a; }
pointAtParameter = Surface.PointAtParameter(surface=flatten_6, u=code_block_7, v=code_block_9, lacing=CrossProduct)
transpose = List.Transpose(lists=pointAtParameter, lacing=Shortest)
byPoints = PolyCurve.ByPoints(points=transpose)
length_3 = Curve.Length(curve=byPoints)
flatten_7 = List.Flatten(list=length_3)
firstItem = List.FirstItem(list=flatten_7)
number_3 = DoubleInput(2)
div = firstItem / number_3
byPoints_2 = PolyCurve.ByPoints(points=pointAtParameter)
length_4 = Curve.Length(curve=byPoints_2)
flatten_8 = List.Flatten(list=length_4)
firstItem_2 = List.FirstItem(list=flatten_8)
div_2 = firstItem_2 / number_3
round = Math.Round(number=div)
round_2 = Math.Round(number=div_2)

# group (continued): Inner fill
code_block_10 = CodeBlock(a=div) { 1/a; }
code_block_11 = CodeBlock(a=code_block_10) { 0..1..~a; }
code_block_12 = CodeBlock(a=div_2) { 1/a; }
code_block_13 = CodeBlock(a=code_block_12) { 0..1..~a; }
pointAtParameter_2 = Surface.PointAtParameter(surface=flatten_5, u=code_block_11, v=code_block_13, lacing=CrossProduct)
byPoints_3 = PolyCurve.ByPoints(points=pointAtParameter_2)
intersect = Geometry.Intersect(geometry=flatten_5, other=byPoints_3)
transpose_2 = List.Transpose(lists=pointAtParameter_2, lacing=Shortest)
byPoints_4 = PolyCurve.ByPoints(points=transpose_2)
intersect_2 = Geometry.Intersect(geometry=flatten_5, other=byPoints_4)
list_create_3 = List.Create(item0=intersect, item1=intersect_2)
flatten_9 = List.Flatten(list=list_create_3)
flatten_10 = List.Flatten(list=flatten_9)
removeIfNot = List.RemoveIfNot(list=flatten_10, type=code_block_5)
setDifference = List.SetDifference(list1=flatten_10, list2=removeIfNot)
intersectAll = Curve.IntersectAll(curves=setDifference)
flatten_11 = List.Flatten(list=intersectAll)
pruneDuplicates = Point.PruneDuplicates(points=flatten_11)
byPoint_3 = FamilyInstance.ByPoint(familyType=shuffle, point=pruneDuplicates, lacing=Shortest)

# group: Subtractor
list_create_4 = List.Create(item0=intersect, item1=intersect_2)
flatten_12 = List.Flatten(list=list_create_4)
code_block_14 = CodeBlock { "Point"; }
removeIfNot_2 = List.RemoveIfNot(list=flatten_12, type=code_block_14)
setDifference_2 = List.SetDifference(list1=flatten_12, list2=removeIfNot_2)
intersect_3 = Geometry.Intersect(geometry=flatten_6, other=byPoints_2)
intersect_4 = Geometry.Intersect(geometry=flatten_6, other=byPoints)
list_create_5 = List.Create(item0=intersect_3, item1=intersect_4)
flatten_13 = List.Flatten(list=list_create_5)
flatten_14 = List.Flatten(list=flatten_13)
code_block_15 = CodeBlock { "Point"; }
removeIfNot_3 = List.RemoveIfNot(list=flatten_14, type=code_block_15)
setDifference_3 = List.SetDifference(list1=flatten_14, list2=removeIfNot_3)
setDifference_4 = List.SetDifference(list1=setDifference_2, list2=setDifference_3)
