# Dynamo graph Shrups Scatter Tool v 1.00.dyn "Shrups Scatter Tool v 1.0" (Dynamo 2.16.2.5624)
# packages: bimorphNodes 3.0.3

# group: #Shrups Scatter Tool v 1.0
# note: #Copyright of Script to Paragons Egypt Team

# group: Adding Families
flowers = FamilyTypes("WTS_Shrubs_Detailed:Flowers")
bush = FamilyTypes("WTS_Shrubs_Detailed:Bush")
# note: # Note : load shrubs Family From Family Mangment
#              Before run the Script
small_bush = FamilyTypes("WTS_Shrubs_Detailed:Small Bush")

# group: 1-Select Shrubs Area
# note: # Secound : Pick Shrubs Area
select_face = DSFaceSelection()  # 1 picked in the model

# group: Script Control
perimeterCurves = Surface.PerimeterCurves(surface=select_face, lacing=Shortest)  # graph output
byJoinedCurves = PolyCurve.ByJoinedCurves(curves=perimeterCurves)

# group: 2- Adjust The Path
# note: # Third : Adjust Spacing Between the Shrubs
space = DoubleSlider(2.1, range=0..100 step 0.1)

# group: Path of Shrups
list_create = List.Create(item0=flowers, item1=bush, item2=flowers, item3=small_bush, item4=flowers, item5=bush, item6=flowers, item7=small_bush, item8=flowers, item9=bush, item10=flowers, item11=small_bush, item12=flowers, item13=bush, item14=flowers, item15=small_bush, item16=flowers, item17=bush, item18=flowers, item19=small_bush, item20=flowers, item21=bush, item22=flowers, item23=small_bush, item24=flowers, item25=bush, item26=flowers, item27=small_bush, item28=flowers, item29=bush, item30=flowers, item31=small_bush, item32=flowers, item33=bush, item34=flowers, item35=small_bush, item36=flowers, item37=bush, item38=flowers, item39=small_bush, item40=flowers, item41=bush, item42=flowers, item43=small_bush, item44=flowers, item45=bush, item46=flowers, item47=small_bush, item48=flowers, item49=bush, item50=flowers, item51=small_bush, item52=flowers, item53=bush, item54=flowers, item55=small_bush, item56=flowers, item57=bush, item58=flowers, item59=small_bush, item60=flowers, item61=bush, item62=flowers, item63=small_bush, item64=flowers, item65=bush, item66=flowers, item67=small_bush, item68=flowers, item69=bush, item70=flowers, item71=small_bush, item72=flowers, item73=bush, item74=flowers, item75=small_bush, item76=flowers, item77=bush, item78=flowers, item79=small_bush, item80=flowers, item81=bush, item82=flowers, item83=small_bush, item84=flowers)
flatten = List.Flatten(list=list_create, lacing=Shortest)
number = DoubleInput(-0.95)
offsetMany = Curve.OffsetMany(curve=byJoinedCurves, signedDistance=number)
length = Curve.Length(curve=offsetMany)
code_block = CodeBlock(length=length, space=space) { length/space; }
code_block_2 = CodeBlock(n=code_block, space=space) { 0..#n..space; }
pointAtSegmentLength = Curve.PointAtSegmentLength(curve=offsetMany, segmentLength=code_block_2)  # graph output
flatten_2 = List.Flatten(list=pointAtSegmentLength)
byPoint = FamilyInstance.ByPoint(familyType=flatten, point=flatten_2, lacing=Shortest)
code_block_3 = CodeBlock(length=length, space=space) { length/space; }

# group: 3- Adjust Area Spacing
# note: #Third : Adjust Spacing by Change the number     next to # sign
code_block_4 = CodeBlock { 0..1..#11; }

# group: Area of Shrups
number_2 = DoubleInput(-2.2)
offsetMany_2 = Curve.OffsetMany(curve=byJoinedCurves, signedDistance=number_2)
byPatch = Surface.ByPatch(closedCurve=offsetMany_2)
code_block_5 = CodeBlock { [0,1]; }
byIsoCurveOnSurface = Curve.ByIsoCurveOnSurface(baseSurface=byPatch, direction=code_block_5, parameter=code_block_4, lacing=CrossProduct)
intersect = Geometry.Intersect(geometry=byPatch, other=byIsoCurveOnSurface)
flatten_3 = List.Flatten(list=intersect)
intersectAll = Curve.IntersectAll(curves=flatten_3)
flatten_4 = List.Flatten(list=intersectAll)
byPoint_2 = FamilyInstance.ByPoint(familyType=flatten, point=flatten_4, lacing=Shortest)
