# Dynamo graph Shrups Scatter Tool v 1.20.dyn "Shrups Scatter Tool v 1.2" (Dynamo 2.16.2.5624)
# packages: bimorphNodes 3.0.3

# group: #Shrups Scatter Tool V 1.2
# note: Ⓒ Copyright of Script to Paragons Egypt Team

bush = FamilyTypes("WTS_Shrubs_Detailed:Bush")
flowers = FamilyTypes("WTS_Shrubs_Detailed:Flowers")
small_bush = FamilyTypes("WTS_Shrubs_Detailed:Small Bush")
list_create = List.Create(item0=bush, item1=flowers, item2=small_bush, item3=flowers)
flatten = List.Flatten(list=list_create)
number = DoubleInput(20)
ofRepeatedItem = List.OfRepeatedItem(item=flatten, amount=number)

# group: 1-Select Shrubs Area
# note: # Note : load shrubs Family From Family Mangment
#              Before run the Script
# note: # First : Pick Shrubs Area
select_face = DSFaceSelection()  # 1 picked in the model

# group: Script Control
perimeterCurves = Surface.PerimeterCurves(surface=select_face, lacing=Shortest)  # graph output
byJoinedCurves = PolyCurve.ByJoinedCurves(curves=perimeterCurves)

# group: 2- Adjust The Path
# note: # Third : Adjust Spacing Between the Shrubs
s_pline_spacing = DoubleSlider(2.1, range=0..100 step 0.1)

# group: Adding Families
flowers_2 = FamilyTypes("WTS_Shrubs_Detailed:Flowers")
# note: # Note
# 1# loop
# 2# points from curve
# 3# curve issue
# 4# Backing Problem
bush_2 = FamilyTypes("WTS_Shrubs_Detailed:Bush")
small_bush_2 = FamilyTypes("WTS_Shrubs_Detailed:Small Bush")

# group: Path of Shrups
flatten_2 = List.Flatten(list=ofRepeatedItem)
number_2 = DoubleInput(-0.95)
offsetMany = Curve.OffsetMany(curve=byJoinedCurves, signedDistance=number_2)
length = Curve.Length(curve=offsetMany)
code_block = CodeBlock(length=length, space=s_pline_spacing) { length/space; }
code_block_2 = CodeBlock(n=code_block, space=s_pline_spacing) { 0..#n..space; }
pointAtSegmentLength = Curve.PointAtSegmentLength(curve=offsetMany, segmentLength=code_block_2)  # graph output
flatten_3 = List.Flatten(list=pointAtSegmentLength)
byPoint = FamilyInstance.ByPoint(familyType=flatten_2, point=flatten_3, lacing=Shortest)
code_block_3 = CodeBlock(length=length, space=s_pline_spacing) { length/space; }
list_create_2 = List.Create(item0=flowers_2, item1=bush_2, item2=flowers_2, item3=small_bush_2, item4=flowers_2, item5=bush_2, item6=flowers_2, item7=small_bush_2, item8=flowers_2, item9=bush_2, item10=flowers_2, item11=small_bush_2, item12=flowers_2, item13=bush_2, item14=flowers_2, item15=small_bush_2, item16=flowers_2, item17=bush_2, item18=flowers_2, item19=small_bush_2, item20=flowers_2, item21=bush_2, item22=flowers_2, item23=small_bush_2, item24=flowers_2, item25=bush_2, item26=flowers_2, item27=small_bush_2, item28=flowers_2, item29=bush_2, item30=flowers_2, item31=small_bush_2, item32=flowers_2, item33=bush_2, item34=flowers_2, item35=small_bush_2, item36=flowers_2, item37=bush_2, item38=flowers_2, item39=small_bush_2, item40=flowers_2, item41=bush_2, item42=flowers_2, item43=small_bush_2, item44=flowers_2, item45=bush_2, item46=flowers_2, item47=small_bush_2, item48=flowers_2, item49=bush_2, item50=flowers_2, item51=small_bush_2, item52=flowers_2, item53=bush_2, item54=flowers_2, item55=small_bush_2, item56=flowers_2, item57=bush_2, item58=flowers_2, item59=small_bush_2, item60=flowers_2, item61=bush_2, item62=flowers_2, item63=small_bush_2, item64=flowers_2, item65=bush_2, item66=flowers_2, item67=small_bush_2, item68=flowers_2, item69=bush_2, item70=flowers_2, item71=small_bush_2, item72=flowers_2, item73=bush_2, item74=flowers_2, item75=small_bush_2, item76=flowers_2, item77=bush_2, item78=flowers_2, item79=small_bush_2, item80=flowers_2, item81=bush_2, item82=flowers_2, item83=small_bush_2, item84=flowers_2, item85=small_bush_2, item86=flowers_2, item87=bush_2, item88=flowers_2, item89=small_bush_2, item90=flowers_2, item91=bush_2, item92=flowers_2, item93=small_bush_2, item94=flowers_2, item95=bush_2, item96=flowers_2, item97=small_bush_2, item98=flowers_2, item99=bush_2, item100=flowers_2)

# group: 3- Adjust Area Spacing
u_direction = DoubleSlider(7.6, range=0..20 step 0.1)
# note: #Third : Adjust Spacing of the Area of the
# Shrubs in U and V direction
v_diraction = DoubleSlider(11.5, range=0..20 step 0.1)

# group: Area of Shrups
number_3 = DoubleInput(-2.3)
offsetMany_2 = Curve.OffsetMany(curve=byJoinedCurves, signedDistance=number_3)
byPatch = Surface.ByPatch(closedCurve=offsetMany_2)
code_block_4 = CodeBlock(a=u_direction) { 1/a; }
code_block_5 = CodeBlock(a=code_block_4) { 0..1..~a; }
code_block_6 = CodeBlock(a=v_diraction) { 1/a; }
code_block_7 = CodeBlock(a=code_block_6) { 0..1..~a; }
pointAtParameter = Surface.PointAtParameter(surface=byPatch, u=code_block_5, v=code_block_7, lacing=CrossProduct)
byPoints = PolyCurve.ByPoints(points=pointAtParameter)
intersect = Geometry.Intersect(geometry=byPatch, other=byPoints)
transpose = List.Transpose(lists=pointAtParameter, lacing=Shortest)
byPoints_2 = PolyCurve.ByPoints(points=transpose)
intersect_2 = Geometry.Intersect(geometry=byPatch, other=byPoints_2)
list_create_3 = List.Create(item0=intersect, item1=intersect_2)
flatten_4 = List.Flatten(list=list_create_3)
intersectAll = Curve.IntersectAll(curves=flatten_4)
flatten_5 = List.Flatten(list=intersectAll)
pruneDuplicates = Point.PruneDuplicates(points=flatten_5)
byPoint_2 = FamilyInstance.ByPoint(familyType=flatten_2, point=pruneDuplicates, lacing=Shortest)
code_block_8 = CodeBlock { [curve]; }  # unwired: curve
removeIfNot = List.RemoveIfNot(type=code_block_8)  # unwired: list
