# Dynamo graph Shrups Scatter Tool v 1.40 .dyn "Shrups Scatter Tool v 1.40" (Dynamo 2.16.2.5624)
# packages: bimorphNodes 3.0.3

# group: #Shrubs Scatter Tool V 1.40
# note: Ⓒ Copyright of Script to Paragons Egypt Team

# group: Scipt Process > Shrubs
bush = FamilyTypes("WTS_Shrubs_Detailed:Bush")
flowers = FamilyTypes("WTS_Shrubs_Detailed:Flowers")
small_bush = FamilyTypes("WTS_Shrubs_Detailed:Small Bush")
list_create = List.Create(item0=bush, item1=flowers, item2=small_bush, item3=flowers)
number = DoubleInput(200)
ofRepeatedItem = List.OfRepeatedItem(item=list_create, amount=number)
flatten = List.Flatten(list=ofRepeatedItem)

# group: 1-Select Shrubs Area
# note: # Note : load shrubs Family From Family Mangment
#              Before run the Script
# note: # First : Pick Shrubs Area
select_face = DSFaceSelection()  # 1 picked in the model

# group: Scipt Process > Script Control
perimeterCurves = Surface.PerimeterCurves(surface=select_face, lacing=Shortest)  # graph output
byJoinedCurves = PolyCurve.ByJoinedCurves(curves=perimeterCurves)

# group: 3- Adjust Area Spacing
u_direction = DoubleSlider(8, range=0..30 step 1)
# note: #Third : Adjust Spacing of the Area of the
# Shrubs in U and V direction
v_diraction = DoubleSlider(8.5, range=0..20 step 0.1)

# group: Scipt Process > Area of Shrups
number_2 = DoubleInput(-2.2)
offsetMany = Curve.OffsetMany(curve=byJoinedCurves, signedDistance=number_2)
byPatch = Surface.ByPatch(closedCurve=offsetMany)
code_block = CodeBlock(a=u_direction) { 1/a; }
code_block_2 = CodeBlock(a=code_block) { 0..1..~a; }
code_block_3 = CodeBlock(a=v_diraction) { 1/a; }
code_block_4 = CodeBlock(a=code_block_3) { 0..1..~a; }
pointAtParameter = Surface.PointAtParameter(surface=byPatch, u=code_block_2, v=code_block_4, lacing=CrossProduct)
byPoints = PolyCurve.ByPoints(points=pointAtParameter)
intersect = Geometry.Intersect(geometry=byPatch, other=byPoints)
transpose = List.Transpose(lists=pointAtParameter, lacing=Shortest)
byPoints_2 = PolyCurve.ByPoints(points=transpose)
intersect_2 = Geometry.Intersect(geometry=byPatch, other=byPoints_2)
list_create_2 = List.Create(item0=intersect, item1=intersect_2)
flatten_2 = List.Flatten(list=list_create_2)
flatten_3 = List.Flatten(list=flatten_2)
code_block_5 = CodeBlock { "Point"; }
removeIfNot = List.RemoveIfNot(list=flatten_3, type=code_block_5)
setDifference = List.SetDifference(list1=flatten_3, list2=removeIfNot)
intersectAll = Curve.IntersectAll(curves=setDifference)
flatten_4 = List.Flatten(list=intersectAll)
pruneDuplicates = Point.PruneDuplicates(points=flatten_4)
byPoint = FamilyInstance.ByPoint(familyType=flatten, point=pruneDuplicates, lacing=Shortest)  # graph output
watch = Watch(flatten_3)

# group: 2- Adjust The Path
# note: # Third : Adjust Spacing Between the Shrubs
s_pline_spacing = DoubleSlider(2.6, range=0..20 step 0.1)

# group: Scipt Process > Path of Shrups
number_3 = DoubleInput(-0.95)
offsetMany_2 = Curve.OffsetMany(curve=byJoinedCurves, signedDistance=number_3)
length = Curve.Length(curve=offsetMany_2)
code_block_6 = CodeBlock(length=length, space=s_pline_spacing) { length/space; }
code_block_7 = CodeBlock(length=length, space=s_pline_spacing) { length/space; }
code_block_8 = CodeBlock(n=code_block_7, space=s_pline_spacing) { 0..#n..space; }
pointAtSegmentLength = Curve.PointAtSegmentLength(curve=offsetMany_2, segmentLength=code_block_8)  # graph output
flatten_5 = List.Flatten(list=pointAtSegmentLength)
byPoint_2 = FamilyInstance.ByPoint(familyType=flatten, point=flatten_5)  # graph output
