# Dynamo graph SCATTER V3.dyn (Dynamo 2.16.2.5624)

# group: #The Path
# note: secound step

# group: #Scatering Area
# note: First Step

# group: 1-Adding Families
flowers = FamilyTypes("WTS_Shrubs_Detailed:Flowers")
bush = FamilyTypes("WTS_Shrubs_Detailed:Bush")
# note: # First : add The  Shrubs Families  in each Family Type by Name
small_bush = FamilyTypes("WTS_Shrubs_Detailed:Small Bush")

# group: 2-Select Shrubs Area
# note: # Secound : Pick Shrubs Area With Model line Tool with Offset of 10"
select_model_elements = DSModelElementsSelection()  # 30 picked in the model

# group: 3- Adjust The Spacing
# note: # Third : Adjust Spacing Between the Shrubs
space = DoubleSlider(5.7, range=0..100 step 0.1)

# group: Script Components
list_create = List.Create(item0=flowers, item1=bush, item2=flowers, item3=small_bush, item4=flowers, item5=bush, item6=flowers, item7=small_bush, item8=flowers, item9=bush, item10=flowers, item11=small_bush, item12=flowers, item13=bush, item14=flowers, item15=small_bush, item16=flowers, item17=bush, item18=flowers, item19=small_bush, item20=flowers, item21=bush, item22=flowers, item23=small_bush, item24=flowers, item25=bush, item26=flowers, item27=small_bush, item28=flowers, item29=bush, item30=flowers, item31=small_bush, item32=flowers, item33=bush, item34=flowers, item35=small_bush, item36=flowers, item37=bush, item38=flowers, item39=small_bush, item40=flowers, item41=bush, item42=flowers, item43=small_bush, item44=flowers, item45=bush, item46=flowers, item47=small_bush, item48=small_bush, item49=bush, item50=small_bush)
flatten = List.Flatten(list=list_create, lacing=Shortest)
geometry = Element.Geometry(element=select_model_elements)
length = Curve.Length(curve=geometry)
code_block = CodeBlock(length=length, space=space) { length/space; }
code_block_2 = CodeBlock(n=code_block, space=space) { 0..#n..space; }
pointAtSegmentLength = Curve.PointAtSegmentLength(curve=geometry, segmentLength=code_block_2)  # graph output
flatten_2 = List.Flatten(list=pointAtSegmentLength)
byPoint = FamilyInstance.ByPoint(familyType=flatten, point=flatten_2, lacing=Shortest)
number = DoubleInput(0)
ofRepeatedItem = List.OfRepeatedItem(amount=number, lacing=Longest)  # unwired: item
flatten_3 = List.Flatten(list=ofRepeatedItem, lacing=Shortest)

# group: 1- Selecting Path
select_model_elements_2 = DSModelElementsSelection()  # 10 picked in the model
# note: # First : Pick Shrubs Area With Model line Tool with Offset of 20"
space_2 = DoubleSlider(0.7, range=0..10 step 0.1)

# group: 2-Adjust The Number Of Shrubs
number_slider = DoubleSlider(7.3, range=0..100 step 0.1)
# note: # Secound : Adjust The Number Of Shrubs and remove the extra Shrubs
number_slider_2 = DoubleSlider(0.4, range=0..100 step 0.1)

# group: Script Components
byPoint_2 = FamilyInstance.ByPoint(lacing=Shortest)  # unwired: familyType, point
geometry_2 = Element.Geometry(element=select_model_elements_2)
length_2 = Curve.Length(curve=geometry_2)
code_block_3 = CodeBlock(length=length_2, space=space_2) { length/space; }
code_block_4 = CodeBlock(n=code_block_3, space=space_2) { 0..#n..space; }
pointAtSegmentLength_2 = Curve.PointAtSegmentLength(curve=geometry_2, segmentLength=code_block_4)  # graph output
flatten_4 = List.Flatten(list=pointAtSegmentLength_2)
byPoints = Polygon.ByPoints(points=flatten_4)
byPatch = Surface.ByPatch(closedCurve=byPoints, lacing=Longest)
code_block_5 = CodeBlock(a=number_slider) { 1/a; }
code_block_6 = CodeBlock(a=code_block_5) { 0..1..~a; }
code_block_7 = CodeBlock(a=number_slider_2) { 1/a; }
code_block_8 = CodeBlock(a=code_block_7) { 0..1..~a; }
pointAtParameter = Surface.PointAtParameter(surface=byPatch, u=code_block_6, v=code_block_8, lacing=CrossProduct)
flatten_5 = List.Flatten(list=pointAtParameter)
byPoint_3 = FamilyInstance.ByPoint(familyType=flatten, point=flatten_5)
