# Dynamo graph SCATTER V6.dyn (Dynamo 2.16.2.5624)
# packages: bimorphNodes 3.0.3

# group: #The Path
# note: First step

# group: 1-Adding Families
flowers = FamilyTypes("WTS_Shrubs_Detailed:Flowers")
bush = FamilyTypes("WTS_Shrubs_Detailed:Bush")
# note: # First : add The  Shrubs Families  in each Family Type by Name
small_bush = FamilyTypes("WTS_Shrubs_Detailed:Small Bush")

# group: 2-Select Shrubs Area
# note: # Secound : Pick Shrubs Area With Model line Tool with Offset of 10"
select_model_elements = DSModelElementsSelection()  # 12 picked in the model

# group: 3- Adjust The Spacing
# note: # Third : Adjust Spacing Between the Shrubs
space = DoubleSlider(5.1, range=0..100 step 0.1)

# group: Script Components
list_create = List.Create(item0=flowers, item1=bush, item2=flowers, item3=small_bush, item4=flowers, item5=bush, item6=flowers, item7=small_bush, item8=flowers, item9=bush, item10=flowers, item11=small_bush, item12=flowers, item13=bush, item14=flowers, item15=small_bush, item16=flowers, item17=bush, item18=flowers, item19=small_bush, item20=flowers, item21=bush, item22=flowers, item23=small_bush, item24=flowers, item25=bush, item26=flowers, item27=small_bush, item28=flowers, item29=bush, item30=flowers, item31=small_bush, item32=flowers, item33=bush, item34=flowers, item35=small_bush, item36=flowers, item37=bush, item38=flowers, item39=small_bush, item40=flowers, item41=bush, item42=flowers, item43=small_bush, item44=flowers, item45=bush, item46=flowers, item47=small_bush, item48=small_bush, item49=bush)
flatten = List.Flatten(list=list_create, lacing=Shortest)
geometry = Element.Geometry(element=select_model_elements)
length = Curve.Length(curve=geometry)
code_block = CodeBlock(length=length, space=space) { length/space; }
code_block_2 = CodeBlock(n=code_block, space=space) { 0..#n..space; }
pointAtSegmentLength = Curve.PointAtSegmentLength(curve=geometry, segmentLength=code_block_2)  # graph output
flatten_2 = List.Flatten(list=pointAtSegmentLength)
byPoint = FamilyInstance.ByPoint(familyType=flatten, point=flatten_2, lacing=Shortest)
code_block_3 = CodeBlock(length=length, space=space) { length/space; }

select_face = DSFaceSelection()  # 1 picked in the model
code_block_4 = CodeBlock { [0,1]; }
code_block_5 = CodeBlock { 0..1..#5; }
byIsoCurveOnSurface = Curve.ByIsoCurveOnSurface(baseSurface=select_face, direction=code_block_4, parameter=[code_block_5, code_block_5], lacing=CrossProduct)
intersect = Geometry.Intersect(geometry=select_face, other=byIsoCurveOnSurface)
flatten_3 = List.Flatten(list=intersect)
intersectAll = Curve.IntersectAll(curves=flatten_3)
perimeterCurves = Surface.PerimeterCurves(surface=select_face)
