# Dynamo graph Scatter v 10.dyn (Dynamo 2.16.2.5624)
# packages: bimorphNodes 3.0.3

# group: #Shrups Scatter Tool v 1.0
# note: #Copyright of Script to Paragons Egypt Team

# group: Script Components
length = Curve.Length()  # unwired: curve
space = DoubleSlider(0.8, range=0..100 step 0.1)  # frozen
code_block = CodeBlock(length=length, space=space) { length/space; }  # frozen
code_block_2 = CodeBlock(n=code_block, space=space) { 0..#n..space; }
pointAtSegmentLength = Curve.PointAtSegmentLength(segmentLength=code_block_2)  # graph output; unwired: curve
flatten = List.Flatten(list=pointAtSegmentLength)
byPoints = Polygon.ByPoints(points=flatten)
byPatch = Surface.ByPatch(closedCurve=byPoints)
code_block_3 = CodeBlock { [0,1]; }
code_block_4 = CodeBlock { 0..1..#10; }
byIsoCurveOnSurface = Curve.ByIsoCurveOnSurface(baseSurface=byPatch, direction=code_block_3, parameter=[code_block_4, code_block_4], lacing=CrossProduct)
intersect = Geometry.Intersect(geometry=byPatch, other=byIsoCurveOnSurface)
flatten_2 = List.Flatten(list=intersect)
intersectAll = Curve.IntersectAll(curves=flatten_2)
code_block_5 = CodeBlock(length=length, space=space) { length/space; }

number_slider = DoubleSlider(6.2, range=0..100 step 0.1)
code_block_6 = CodeBlock(a=number_slider) { 1/a; }
code_block_7 = CodeBlock(a=code_block_6) { 0..1..~a; }
number_slider_2 = DoubleSlider(6.2, range=0..100 step 0.1)
code_block_8 = CodeBlock(a=number_slider_2) { 1/a; }
code_block_9 = CodeBlock(a=code_block_8) { 0..1..~a; }
pointAtParameter = Surface.PointAtParameter(u=code_block_7, v=code_block_9, lacing=CrossProduct)  # unwired: surface
number_slider_3 = DoubleSlider(83.8, range=0..100 step 0.1)
number_slider_4 = DoubleSlider(1, range=0..100 step 0.1)
byCoordinates = UV.ByCoordinates(u=number_slider_3, v=number_slider_4)

# group: Adding Families
flowers = FamilyTypes("WTS_Shrubs_Detailed:Flowers")
bush = FamilyTypes("WTS_Shrubs_Detailed:Bush")
# note: # Note : load shrubs Family From Family Mangment
#              Before run the Script
small_bush = FamilyTypes("WTS_Shrubs_Detailed:Small Bush")

# group: 1-Select Shrubs Area
# note: # Secound : Pick Shrubs Area
select_face = DSFaceSelection()  # 1 picked in the model

# group: Script Control
perimeterCurves = Surface.PerimeterCurves(surface=select_face, lacing=Shortest)  # graph output
byJoinedCurves = PolyCurve.ByJoinedCurves(curves=perimeterCurves)

# group: 2- Adjust The Path
# note: # Third : Adjust Spacing Between the Shrubs
space_2 = DoubleSlider(2.7, range=0..100 step 0.1)

# group: Path of Shrups
list_create = List.Create(item0=flowers, item1=bush, item2=flowers, item3=small_bush, item4=flowers, item5=bush, item6=flowers, item7=small_bush, item8=flowers, item9=bush, item10=flowers, item11=small_bush, item12=flowers, item13=bush, item14=flowers, item15=small_bush, item16=flowers, item17=bush, item18=flowers, item19=small_bush, item20=flowers, item21=bush, item22=flowers, item23=small_bush, item24=flowers, item25=bush, item26=flowers, item27=small_bush, item28=flowers, item29=bush, item30=flowers, item31=small_bush, item32=flowers, item33=bush, item34=flowers, item35=small_bush, item36=flowers, item37=bush, item38=flowers, item39=small_bush, item40=flowers, item41=bush, item42=flowers, item43=small_bush, item44=flowers, item45=bush, item46=flowers, item47=small_bush, item48=flowers, item49=bush, item50=flowers, item51=small_bush, item52=flowers, item53=bush, item54=flowers, item55=small_bush, item56=flowers, item57=bush, item58=flowers, item59=small_bush, item60=flowers, item61=bush, item62=flowers, item63=small_bush, item64=flowers, item65=bush, item66=flowers, item67=small_bush, item68=flowers, item69=bush, item70=flowers, item71=small_bush, item72=flowers, item73=bush, item74=flowers, item75=small_bush, item76=flowers, item77=bush, item78=flowers, item79=small_bush, item80=flowers, item81=bush, item82=flowers, item83=small_bush, item84=flowers)
flatten_3 = List.Flatten(list=list_create, lacing=Shortest)
number = DoubleInput(-0.95)
offsetMany = Curve.OffsetMany(curve=byJoinedCurves, signedDistance=number)
length_2 = Curve.Length(curve=offsetMany)
code_block_10 = CodeBlock(length=length_2, space=space_2) { length/space; }
code_block_11 = CodeBlock(n=code_block_10, space=space_2) { 0..#n..space; }
pointAtSegmentLength_2 = Curve.PointAtSegmentLength(curve=offsetMany, segmentLength=code_block_11)  # graph output
flatten_4 = List.Flatten(list=pointAtSegmentLength_2)
byPoint = FamilyInstance.ByPoint(familyType=flatten_3, point=flatten_4, lacing=Shortest)
code_block_12 = CodeBlock(length=length_2, space=space_2) { length/space; }

# group: 3- Adjust Area Spacing
# note: #Third : Adjust Spacing by Change the number     next to # sign by an odd Number
code_block_13 = CodeBlock { 0..1..#11; }

# group: Area of Shrups
number_2 = DoubleInput(-2.2)
offsetMany_2 = Curve.OffsetMany(curve=byJoinedCurves, signedDistance=number_2)
byPatch_2 = Surface.ByPatch(closedCurve=offsetMany_2)
code_block_14 = CodeBlock { [0,1]; }
byIsoCurveOnSurface_2 = Curve.ByIsoCurveOnSurface(baseSurface=byPatch_2, direction=code_block_14, parameter=code_block_13, lacing=CrossProduct)
intersect_2 = Geometry.Intersect(geometry=byPatch_2, other=byIsoCurveOnSurface_2)
flatten_5 = List.Flatten(list=intersect_2)
intersectAll_2 = Curve.IntersectAll(curves=flatten_5)
flatten_6 = List.Flatten(list=intersectAll_2)
byPoint_2 = FamilyInstance.ByPoint(familyType=flatten_3, point=flatten_6, lacing=Shortest)
