# Dynamo graph Scatter v8.dyn (Dynamo 2.16.2.5624)
# packages: bimorphNodes 3.0.3

# group: #The Path
# note: First step

# group: Script Components
length = Curve.Length()  # unwired: curve
space = DoubleSlider(0.8, range=0..100 step 0.1)  # frozen
code_block = CodeBlock(length=length, space=space) { length/space; }  # frozen
code_block_2 = CodeBlock(n=code_block, space=space) { 0..#n..space; }
pointAtSegmentLength = Curve.PointAtSegmentLength(segmentLength=code_block_2)  # graph output; unwired: curve
flatten = List.Flatten(list=pointAtSegmentLength)
byPoints = Polygon.ByPoints(points=flatten)
byPatch = Surface.ByPatch(closedCurve=byPoints)
code_block_3 = CodeBlock { [0,1]; }
code_block_4 = CodeBlock { 0..1..#10; }
byIsoCurveOnSurface = Curve.ByIsoCurveOnSurface(baseSurface=byPatch, direction=code_block_3, parameter=[code_block_4, code_block_4], lacing=CrossProduct)
intersect = Geometry.Intersect(geometry=byPatch, other=byIsoCurveOnSurface)
flatten_2 = List.Flatten(list=intersect)
intersectAll = Curve.IntersectAll(curves=flatten_2)
code_block_5 = CodeBlock(length=length, space=space) { length/space; }

number_slider = DoubleSlider(6.2, range=0..100 step 0.1)
code_block_6 = CodeBlock(a=number_slider) { 1/a; }
code_block_7 = CodeBlock(a=code_block_6) { 0..1..~a; }
number_slider_2 = DoubleSlider(6.2, range=0..100 step 0.1)
code_block_8 = CodeBlock(a=number_slider_2) { 1/a; }
code_block_9 = CodeBlock(a=code_block_8) { 0..1..~a; }
pointAtParameter = Surface.PointAtParameter(u=code_block_7, v=code_block_9, lacing=CrossProduct)  # unwired: surface
byCoordinates = UV.ByCoordinates()

# group: 1-Adding Families
flowers = FamilyTypes("WTS_Shrubs_Detailed:Flowers")
bush = FamilyTypes("WTS_Shrubs_Detailed:Bush")
# note: # First : add The  Shrubs Families  in each Family Type by Name
small_bush = FamilyTypes("WTS_Shrubs_Detailed:Small Bush")

select_face = DSFaceSelection()  # 1 picked in the model
perimeterCurves = Surface.PerimeterCurves(surface=select_face, lacing=Shortest)  # graph output

# group: 3- Adjust The Spacing
# note: # Third : Adjust Spacing Between the Shrubs
space_2 = DoubleSlider(10.3, range=0..100 step 0.1)

# group: 2-Select Shrubs Area
# note: # Secound : Pick Shrubs Area With Model line Tool with Offset of 10"
select_model_elements = DSModelElementsSelection()  # nothing selected

# group: Script Components
list_create = List.Create(item0=flowers, item1=bush, item2=flowers, item3=small_bush, item4=flowers, item5=bush, item6=flowers, item7=small_bush, item8=flowers, item9=bush, item10=flowers, item11=small_bush, item12=flowers, item13=bush, item14=flowers, item15=small_bush, item16=flowers, item17=bush, item18=flowers, item19=small_bush, item20=flowers, item21=bush, item22=flowers, item23=small_bush, item24=flowers, item25=bush, item26=flowers, item27=small_bush, item28=flowers, item29=bush, item30=flowers, item31=small_bush, item32=flowers, item33=bush, item34=flowers, item35=small_bush, item36=flowers, item37=bush, item38=flowers, item39=small_bush, item40=flowers, item41=bush, item42=flowers, item43=small_bush, item44=flowers, item45=bush, item46=flowers, item47=small_bush, item48=small_bush, item49=bush)
flatten_3 = List.Flatten(list=list_create, lacing=Shortest)
length_2 = Curve.Length(curve=perimeterCurves)
code_block_10 = CodeBlock(length=length_2, space=space_2) { length/space; }
code_block_11 = CodeBlock(n=code_block_10, space=space_2) { 0..#n..space; }
pointAtSegmentLength_2 = Curve.PointAtSegmentLength(curve=perimeterCurves, segmentLength=code_block_11)  # graph output
flatten_4 = List.Flatten(list=pointAtSegmentLength_2)
byPoint = FamilyInstance.ByPoint(familyType=flatten_3, point=flatten_4, lacing=Shortest)
code_block_12 = CodeBlock(length=length_2, space=space_2) { length/space; }
geometry = Element.Geometry(element=select_model_elements)

byJoinedCurves = PolyCurve.ByJoinedCurves(curves=perimeterCurves)
byPatch_2 = Surface.ByPatch()  # unwired: closedCurve
code_block_13 = CodeBlock { [0,1]; }
code_block_14 = CodeBlock { 0..1..#10; }
byIsoCurveOnSurface_2 = Curve.ByIsoCurveOnSurface(baseSurface=byPatch_2, direction=code_block_13, parameter=code_block_14, lacing=CrossProduct)
intersect_2 = Geometry.Intersect(geometry=byPatch_2, other=byIsoCurveOnSurface_2)
flatten_5 = List.Flatten(list=intersect_2)
intersectAll_2 = Curve.IntersectAll(curves=flatten_5)
offsetMany = Curve.OffsetMany()  # unwired: curve
