# Dynamo graph Shrubs Scatter Tool v 1.56 .dyn "Shrubs Scatter Tool v 1.56" (Dynamo 2.16.2.5624)
# Scattering the shrubs by making offsets of selected faces following the order

# group: #Shrubs Scatter Tool V 1.56
# note: Ⓒ Copyright of Script to Paragons Egypt Team

# group: Scipt Process > Shrubs
bush = FamilyTypes("WTS_Shrubs_Detailed:Bush")
flowers = FamilyTypes("WTS_Shrubs_Detailed:Flowers")
small_bush = FamilyTypes("WTS_Shrubs_Detailed:Small Bush")
list_create = List.Create(item0=bush, item1=flowers, item2=small_bush)
number = DoubleInput(200)
ofRepeatedItem = List.OfRepeatedItem(item=list_create, amount=number)
randomization = DoubleSlider(32, range=1..100 step 1)  # graph input
flatten = List.Flatten(list=ofRepeatedItem, amount=randomization)
shuffle = List.Shuffle(list=flatten, seed=randomization)
list_create_2 = List.Create(item0=bush, item1=flowers, item2=small_bush, item3=flowers)
ofRepeatedItem_2 = List.OfRepeatedItem(item=list_create_2, amount=number)
flatten_2 = List.Flatten(list=ofRepeatedItem_2)

# group: Select Shrubs Area
# note: # Note : load shrubs Family From Family Mangment
#              Before run the Script
# note: # First : Pick Shrubs Area
select_shrub_floor_face_make = DSFaceSelection()  # "-Select Shrub Floor Face " make sure to add Shrubs Family Before run the script ""; 1 picked in the model; graph input

# group: Scipt Process > Script Control
perimeterCurves = Surface.PerimeterCurves(surface=select_shrub_floor_face_make, lacing=Shortest)
byJoinedCurves = PolyCurve.ByJoinedCurves(curves=perimeterCurves)

# group: Control
spacing = DoubleSlider(-1.75, range=-2..-1.65 step 0.05)  # graph input
code_block = CodeBlock(n=spacing) { n-1; }

# group: Control > offset 0
outter_offset = DoubleInput(0)
mul = spacing * outter_offset
add = code_block + mul

# group: Scipt Process > 3- Adjust The spacing Between Shrubs
# note: # Just in case if needed to Adjust Spacing Between the Shrubs
j_i_c_the_distance_between = DoubleInput(2.3)  # "J.I.C-*The Distance between Shrubs at the Path (Check Order)"

# group: Inner Part > Path of Shrubs
offsetMany = Curve.OffsetMany(curve=byJoinedCurves, signedDistance=add)
length = Curve.Length(curve=offsetMany)
code_block_2 = CodeBlock(length=length, space=j_i_c_the_distance_between) { length/space; }
code_block_3 = CodeBlock(n=code_block_2, space=j_i_c_the_distance_between) { 0..#n..space; }
pointAtSegmentLength = Curve.PointAtSegmentLength(curve=offsetMany, segmentLength=code_block_3)
flatten_3 = List.Flatten(list=pointAtSegmentLength)
code_block_4 = CodeBlock(length=length, space=j_i_c_the_distance_between) { length/space; }

# group: Control > offset 2
outter_offset_2 = DoubleInput(2)
mul_2 = spacing * outter_offset_2
add_2 = code_block + mul_2

# group: Inner Part > Path of Shrubs
offsetMany_2 = Curve.OffsetMany(curve=byJoinedCurves, signedDistance=add_2)
length_2 = Curve.Length(curve=offsetMany_2)
code_block_5 = CodeBlock(length=length_2, space=j_i_c_the_distance_between) { length/space; }
code_block_6 = CodeBlock(n=code_block_5, space=j_i_c_the_distance_between) { 0..#n..space; }
pointAtSegmentLength_2 = Curve.PointAtSegmentLength(curve=offsetMany_2, segmentLength=code_block_6)
flatten_4 = List.Flatten(list=pointAtSegmentLength_2)
code_block_7 = CodeBlock(length=length_2, space=j_i_c_the_distance_between) { length/space; }

# group: Control > offset 4
outter_offset_3 = DoubleInput(4)
mul_3 = spacing * outter_offset_3
add_3 = code_block + mul_3

# group: Inner Part > Path of Shrubs
offsetMany_3 = Curve.OffsetMany(curve=byJoinedCurves, signedDistance=add_3)
length_3 = Curve.Length(curve=offsetMany_3)
code_block_8 = CodeBlock(length=length_3, space=j_i_c_the_distance_between) { length/space; }
code_block_9 = CodeBlock(n=code_block_8, space=j_i_c_the_distance_between) { 0..#n..space; }
pointAtSegmentLength_3 = Curve.PointAtSegmentLength(curve=offsetMany_3, segmentLength=code_block_9)
flatten_5 = List.Flatten(list=pointAtSegmentLength_3)
code_block_10 = CodeBlock(length=length_3, space=j_i_c_the_distance_between) { length/space; }

# group: Control > offset 6
outter_offset_4 = DoubleInput(6)
mul_4 = spacing * outter_offset_4
add_4 = code_block + mul_4

# group: Inner Part > Path of Shrubs
offsetMany_4 = Curve.OffsetMany(curve=byJoinedCurves, signedDistance=add_4)
length_4 = Curve.Length(curve=offsetMany_4)
code_block_11 = CodeBlock(length=length_4, space=j_i_c_the_distance_between) { length/space; }
code_block_12 = CodeBlock(n=code_block_11, space=j_i_c_the_distance_between) { 0..#n..space; }
pointAtSegmentLength_4 = Curve.PointAtSegmentLength(curve=offsetMany_4, segmentLength=code_block_12)
flatten_6 = List.Flatten(list=pointAtSegmentLength_4)
code_block_13 = CodeBlock(length=length_4, space=j_i_c_the_distance_between) { length/space; }

# group: Control > offset 8
outter_offset_5 = DoubleInput(8)
mul_5 = spacing * outter_offset_5
add_5 = code_block + mul_5

# group: Inner Part > Path of Shrubs
offsetMany_5 = Curve.OffsetMany(curve=byJoinedCurves, signedDistance=add_5)
length_5 = Curve.Length(curve=offsetMany_5)
code_block_14 = CodeBlock(length=length_5, space=j_i_c_the_distance_between) { length/space; }
code_block_15 = CodeBlock(n=code_block_14, space=j_i_c_the_distance_between) { 0..#n..space; }
pointAtSegmentLength_5 = Curve.PointAtSegmentLength(curve=offsetMany_5, segmentLength=code_block_15)
flatten_7 = List.Flatten(list=pointAtSegmentLength_5)
code_block_16 = CodeBlock(length=length_5, space=j_i_c_the_distance_between) { length/space; }

# group: Control > offset 10
outter_offset_6 = DoubleInput(10)
mul_6 = spacing * outter_offset_6
add_6 = code_block + mul_6

# group: Inner Part > Path of Shrubs
offsetMany_6 = Curve.OffsetMany(curve=byJoinedCurves, signedDistance=add_6)
length_6 = Curve.Length(curve=offsetMany_6)
code_block_17 = CodeBlock(length=length_6, space=j_i_c_the_distance_between) { length/space; }
code_block_18 = CodeBlock(n=code_block_17, space=j_i_c_the_distance_between) { 0..#n..space; }
pointAtSegmentLength_6 = Curve.PointAtSegmentLength(curve=offsetMany_6, segmentLength=code_block_18)
flatten_8 = List.Flatten(list=pointAtSegmentLength_6)
code_block_19 = CodeBlock(length=length_6, space=j_i_c_the_distance_between) { length/space; }

# group: Control > offset 1
outter_offset_7 = DoubleInput(1)
mul_7 = spacing * outter_offset_7
add_7 = code_block + mul_7

# group: Inner Part > Path of Shrubs
offsetMany_7 = Curve.OffsetMany(curve=byJoinedCurves, signedDistance=add_7)
length_7 = Curve.Length(curve=offsetMany_7)
code_block_20 = CodeBlock(length=length_7, space=j_i_c_the_distance_between) { length/space; }
code_block_21 = CodeBlock(n=code_block_20, space=j_i_c_the_distance_between) { 0..#n..space; }
pointAtSegmentLength_7 = Curve.PointAtSegmentLength(curve=offsetMany_7, segmentLength=code_block_21)
flatten_9 = List.Flatten(list=pointAtSegmentLength_7)
code_block_22 = CodeBlock(length=length_7, space=j_i_c_the_distance_between) { length/space; }

# group: Control > offset 3
outter_offset_8 = DoubleInput(3)
mul_8 = spacing * outter_offset_8
add_8 = code_block + mul_8

# group: Inner Part > Path of Shrubs
offsetMany_8 = Curve.OffsetMany(curve=byJoinedCurves, signedDistance=add_8)
length_8 = Curve.Length(curve=offsetMany_8)
code_block_23 = CodeBlock(length=length_8, space=j_i_c_the_distance_between) { length/space; }
code_block_24 = CodeBlock(n=code_block_23, space=j_i_c_the_distance_between) { 0..#n..space; }
pointAtSegmentLength_8 = Curve.PointAtSegmentLength(curve=offsetMany_8, segmentLength=code_block_24)
flatten_10 = List.Flatten(list=pointAtSegmentLength_8)
code_block_25 = CodeBlock(length=length_8, space=j_i_c_the_distance_between) { length/space; }

# group: Control > offset 5
outter_offset_9 = DoubleInput(5)
mul_9 = spacing * outter_offset_9
add_9 = code_block + mul_9

# group: Inner Part > Path of Shrubs
offsetMany_9 = Curve.OffsetMany(curve=byJoinedCurves, signedDistance=add_9)
length_9 = Curve.Length(curve=offsetMany_9)
code_block_26 = CodeBlock(length=length_9, space=j_i_c_the_distance_between) { length/space; }
code_block_27 = CodeBlock(n=code_block_26, space=j_i_c_the_distance_between) { 0..#n..space; }
pointAtSegmentLength_9 = Curve.PointAtSegmentLength(curve=offsetMany_9, segmentLength=code_block_27)
flatten_11 = List.Flatten(list=pointAtSegmentLength_9)
code_block_28 = CodeBlock(length=length_9, space=j_i_c_the_distance_between) { length/space; }

# group: Control > offset 7
outter_offset_10 = DoubleInput(7)
mul_10 = spacing * outter_offset_10
add_10 = code_block + mul_10

# group: Inner Part > Path of Shrubs
offsetMany_10 = Curve.OffsetMany(curve=byJoinedCurves, signedDistance=add_10)
length_10 = Curve.Length(curve=offsetMany_10)
code_block_29 = CodeBlock(length=length_10, space=j_i_c_the_distance_between) { length/space; }
code_block_30 = CodeBlock(n=code_block_29, space=j_i_c_the_distance_between) { 0..#n..space; }
pointAtSegmentLength_10 = Curve.PointAtSegmentLength(curve=offsetMany_10, segmentLength=code_block_30)
flatten_12 = List.Flatten(list=pointAtSegmentLength_10)
code_block_31 = CodeBlock(length=length_10, space=j_i_c_the_distance_between) { length/space; }

# group: Control > offset 9
outter_offset_11 = DoubleInput(9)
mul_11 = spacing * outter_offset_11
add_11 = code_block + mul_11

# group: Inner Part > Path of Shrubs
offsetMany_11 = Curve.OffsetMany(curve=byJoinedCurves, signedDistance=add_11)
length_11 = Curve.Length(curve=offsetMany_11)
code_block_32 = CodeBlock(length=length_11, space=j_i_c_the_distance_between) { length/space; }
code_block_33 = CodeBlock(n=code_block_32, space=j_i_c_the_distance_between) { 0..#n..space; }
pointAtSegmentLength_11 = Curve.PointAtSegmentLength(curve=offsetMany_11, segmentLength=code_block_33)
flatten_13 = List.Flatten(list=pointAtSegmentLength_11)
code_block_34 = CodeBlock(length=length_11, space=j_i_c_the_distance_between) { length/space; }

# group: Control > offset 11
outter_offset_12 = DoubleInput(11)
mul_12 = spacing * outter_offset_12
add_12 = code_block + mul_12

# group: Inner Part > Path of Shrubs
offsetMany_12 = Curve.OffsetMany(curve=byJoinedCurves, signedDistance=add_12)
length_12 = Curve.Length(curve=offsetMany_12)
code_block_35 = CodeBlock(length=length_12, space=j_i_c_the_distance_between) { length/space; }
code_block_36 = CodeBlock(n=code_block_35, space=j_i_c_the_distance_between) { 0..#n..space; }
pointAtSegmentLength_12 = Curve.PointAtSegmentLength(curve=offsetMany_12, segmentLength=code_block_36)
flatten_14 = List.Flatten(list=pointAtSegmentLength_12)
code_block_37 = CodeBlock(length=length_12, space=j_i_c_the_distance_between) { length/space; }

# group: Output
list_create_3 = List.Create(item0=flatten_3, item1=flatten_4, item2=flatten_5, item3=flatten_6, item4=flatten_7, item5=flatten_8)
reverse = List.Reverse(list=list_create_3)
list_create_4 = List.Create(item0=flatten_9, item1=flatten_10, item2=flatten_11, item3=flatten_12, item4=flatten_13, item5=flatten_14)
list_create_5 = List.Create(item0=reverse, item1=list_create_4)
flatten_15 = List.Flatten(list=list_create_5)
byPoint = FamilyInstance.ByPoint(familyType=shuffle, point=flatten_15)

# group: Outer Path of Shrubs
outter_offset_13 = DoubleInput(-1)
offsetMany_13 = Curve.OffsetMany(curve=byJoinedCurves, signedDistance=outter_offset_13)
length_13 = Curve.Length(curve=offsetMany_13)
code_block_38 = CodeBlock(length=length_13, space=j_i_c_the_distance_between) { length/space; }
code_block_39 = CodeBlock(n=code_block_38, space=j_i_c_the_distance_between) { 0..#n..space; }
pointAtSegmentLength_13 = Curve.PointAtSegmentLength(curve=offsetMany_13, segmentLength=code_block_39)
flatten_16 = List.Flatten(list=pointAtSegmentLength_13)
byPoint_2 = FamilyInstance.ByPoint(familyType=flatten_2, point=flatten_16)
